# Grasshopper definition Pop-Up Box Script.gh (Grasshopper 1.0.7)

# ----
# Value of x
# Value of a
# Value of y
# Value of h
number_slider = Slider(114, range=0..1000)
number_slider_2 = Slider(30, range=0..100)
number_slider_3 = Slider(20, range=0..210)

rectangle = Rectangle(Plane=PlaneXY(0, 0, 0), XSize="420", YSize="297", Radius=0)  # -> Rectangle, Length
explode = Explode(Curve=rectangle.Rectangle, Recursive=True)  # -> Segments, Vertices
curve_middle = CurveMiddle(Curve=explode.Segments)
list_item = ListItem(List=curve_middle, Index=0, Wrap=True)
list_item_2 = ListItem(List=curve_middle, Index=2, Wrap=True)
line = Line(StartPoint=list_item, EndPoint=list_item_2)

square_root = SquareRoot(Value=2)
division = Division(A=Slider(60, range=0..100), B=square_root)
boundary_surfaces = BoundarySurfaces(Edges=explode.Segments)

construct_point = ConstructPoint(XCoordinate="297", YCoordinate="297+210+210", ZCoordinate=0)
construct_point_2 = ConstructPoint(XCoordinate="0", YCoordinate="297+210", ZCoordinate=0)
h = Number(number_slider_2)
p = Number(Slider(20, range=0..100))
addition = Addition(A=h, B=p)
addition_2 = Addition(A="297+210", B=addition)
rectangle_2pt = Rectangle2Pt(Plane=PlaneXY(0, 0, 0), PointA=construct_point, PointB=construct_point_2, Radius=0)  # -> Rectangle, Length
construct_point_3 = ConstructPoint(XCoordinate=addition, YCoordinate=addition_2, ZCoordinate=0)
square_root_2 = SquareRoot(Value=2)
p_2_h = VectorXYZ(XComponent=expr("x/2", p), YComponent=h, ZComponent=0)  # -> Vector, Length
unit_x = UnitX(Factor=expr("-x", h))

integer_division = IntegerDivision(A="420", B=2)
unit_x_2 = UnitX(Factor=expr("-x", division))
unit_y = UnitY(Factor=expr("-x", division))
unit_x_3 = UnitX(Factor=division)
unit_y_2 = UnitY(Factor=division)
addition_3 = Addition(A=number_slider_3, B=division)
vector_xyz = VectorXYZ(XComponent=addition_3, YComponent=addition_3, ZComponent=0)  # -> Vector, Length

subtraction = Subtraction(A=integer_division, B=division, C=number_slider_3)

construct_point_4 = ConstructPoint(XCoordinate=subtraction, YCoordinate=number_slider, ZCoordinate=0)
move = Move(Geometry=construct_point_4, Motion=[unit_x_3, unit_y_2, unit_x_2, unit_y])  # -> Geometry, Transform
list_item_3 = ListItem(List=move.Geometry, Index=0, Wrap=True)
polyline = PolyLine(Vertices=move.Geometry, Closed=True)
length = Length(Curve=polyline)  # -> expr("x/4", Length)
panel = Panel(length)

box_rectangle = BoxRectangle(Rectangle=polyline, Height=number_slider_2)
custom_preview = CustomPreview(Geometry=box_rectangle, Material=ColourSwatch(SwatchColor=RGB(106, 255, 0)))

a = Number(length)
a_h = VectorXYZ(XComponent=expr("-x", a), YComponent=h, ZComponent=0)  # -> Vector, Length
vector_xyz_2 = VectorXYZ(XComponent=h, YComponent=expr("-x", a), ZComponent=0)  # -> Vector, Length
aa = VectorXYZ(XComponent=a, YComponent=a, ZComponent=0)  # -> Vector, Length
h_a = VectorXYZ(XComponent=expr("-x", h), YComponent=a, ZComponent=0)  # -> Vector, Length
vector_xyz_3 = VectorXYZ(XComponent=a, YComponent=expr("-x", h), ZComponent=0)  # -> Vector, Length
move_2 = Move(Geometry=construct_point_3, Motion=aa.Vector)  # -> Geometry, Transform
move_3 = Move(Geometry=move_2.Geometry, Motion=vector_xyz_2.Vector)  # -> Geometry, Transform
move_4 = Move(Geometry=move_2.Geometry, Motion=a_h.Vector)  # -> Geometry, Transform
subtraction_2 = Subtraction(A=a, B=h)
move_5 = Move(Geometry=construct_point_3, Motion=h_a.Vector)  # -> Geometry, Transform
move_6 = Move(Geometry=construct_point_3, Motion=vector_xyz_3.Vector)  # -> Geometry, Transform
rectangle_2pt_2 = Rectangle2Pt(Plane=PlaneXY(0, 0, 0), PointA=construct_point_3, PointB=move_2.Geometry, Radius=0)  # -> Rectangle, Length
division_2 = Division(A=subtraction_2, B=square_root_2)
rectangle_2pt_3 = Rectangle2Pt(Plane=PlaneXY(0, 0, 0), PointA=move_2.Geometry, PointB=move_4.Geometry, Radius=0)  # -> Rectangle, Length
rectangle_2pt_4 = Rectangle2Pt(Plane=PlaneXY(0, 0, 0), PointA=move_2.Geometry, PointB=move_3.Geometry, Radius=0)  # -> Rectangle, Length
rectangle_2pt_5 = Rectangle2Pt(Plane=PlaneXY(0, 0, 0), PointA=construct_point_3, PointB=move_6.Geometry, Radius=0)  # -> Rectangle, Length
rectangle_2pt_6 = Rectangle2Pt(Plane=PlaneXY(0, 0, 0), PointA=construct_point_3, PointB=move_5.Geometry, Radius=0)  # -> Rectangle, Length
subtraction_3 = Subtraction(A=a, B=h)
move_7 = Move(Geometry=move_3.Geometry, Motion=aa.Vector)  # -> Geometry, Transform
a_h_a = VectorXYZ(XComponent=subtraction_3, YComponent=a, ZComponent=0)  # -> Vector, Length
move_8 = Move(Geometry=move_6.Geometry, Motion=p_2_h.Vector)  # -> Geometry, Transform
p_a = VectorXYZ(XComponent=expr("-x", p), YComponent=expr("-x", a), ZComponent=0)  # -> Vector, Length
move_9 = Move(Geometry=move_4.Geometry, Motion=a_h_a.Vector)  # -> Geometry, Transform
move_10 = Move(Geometry=move_5.Geometry, Motion=p_a.Vector)  # -> Geometry, Transform
rectangle_2pt_7 = Rectangle2Pt(Plane=PlaneXY(0, 0, 0), PointA=move_10.Geometry, PointB=move_5.Geometry, Radius=0)  # -> Rectangle, Length
rectangle_2pt_8 = Rectangle2Pt(Plane=PlaneXY(0, 0, 0), PointA=move_7.Geometry, PointB=move_3.Geometry, Radius=0)  # -> Rectangle, Length
rectangle_2pt_9 = Rectangle2Pt(Plane=PlaneXY(0, 0, 0), PointA=move_8.Geometry, PointB=move_6.Geometry, Radius=0)  # -> Rectangle, Length
move_11 = Move(Geometry=move_6.Geometry, Motion=unit_x)  # -> Geometry, Transform
move_12 = Move(Geometry=move_9.Geometry, Motion=vector_xyz_2.Vector)  # -> Geometry, Transform
rectangle_2pt_10 = Rectangle2Pt(Plane=PlaneXY(0, 0, 0), PointA=move_9.Geometry, PointB=move_4.Geometry, Radius=0)  # -> Rectangle, Length
a_h_p = VectorXYZ(XComponent=expr("-x", subtraction_3), YComponent=expr("-x", p), ZComponent=0)  # -> Vector, Length
line_2 = Line(StartPoint=move_9.Geometry, EndPoint=move_12.Geometry)
move_13 = Move(Geometry=move_11.Geometry, Motion=a_h_p.Vector)  # -> Geometry, Transform
rectangle_2pt_11 = Rectangle2Pt(Plane=PlaneXY(0, 0, 0), PointA=move_13.Geometry, PointB=move_11.Geometry, Radius=0)  # -> Rectangle, Length

vector_xyz_4 = VectorXYZ(XComponent=expr("-x", division_2), YComponent=division_2, ZComponent=0)  # -> Vector, Length
move_14 = Move(Geometry=list_item_3, Motion=vector_xyz_4.Vector)  # -> Geometry, Transform
move_15 = Move(Geometry=move_14.Geometry, Motion=vector_xyz.Vector)  # -> Geometry, Transform
multiplication = Multiplication(A=square_root_2, B=subtraction_2)
unit_y_3 = UnitY(Factor=expr("-x", multiplication))
move_16 = Move(Geometry=move_15.Geometry, Motion=unit_y_3)  # -> Geometry, Transform
rectangle_3pt = Rectangle3Pt(PointA=list_item_3, PointB=move_14.Geometry, PointC=move_15.Geometry)  # -> Rectangle, Length
line_3 = Line(StartPoint=move_15.Geometry, EndPoint=move_16.Geometry)

addition_4 = Addition(A=subtraction_2, B=number_slider_3)

vector_xyz_5 = VectorXYZ(XComponent=expr("-2*x", addition_4), YComponent=expr("-x", subtraction_2), ZComponent=0)  # -> Vector, Length
move_17 = Move(Geometry=construct_point, Motion=vector_xyz_5.Vector)  # -> Geometry, Transform
rectangle_2pt_12 = Rectangle2Pt(Plane=PlaneXY(0, 0, 0), PointA=move_17.Geometry, PointB=construct_point, Radius=0)  # -> Rectangle, Length

# ----
# Pop-up Box Base
group = Group(Objects=[rectangle.Rectangle, line, polyline, rectangle_3pt.Rectangle, line_3])

# ----
# Pop-up Box Pattern
group_2 = Group(Objects=[rectangle_2pt_12.Rectangle, rectangle_2pt_2.Rectangle, line_2, rectangle_2pt_4.Rectangle, rectangle_2pt_10.Rectangle, rectangle_2pt_8.Rectangle, rectangle_2pt_9.Rectangle, rectangle_2pt_11.Rectangle, rectangle_2pt_3.Rectangle, rectangle_2pt_7.Rectangle, rectangle_2pt_6.Rectangle, rectangle_2pt_5.Rectangle])
